# Grasshopper definition THR34D5Example.gh (Grasshopper 0.9.76)
# plug-ins: WebMercatorProjection, SphericalProjection, CassiniProjection, Tarsier, GdalNightmare

number_slider = Slider(1, range=0..1)
panel = Panel("D:\Downloads\pre.grb2")
number_slider_2 = Slider(0, range=0..100)
number_slider_3 = Slider(1, range=0..1)
read_information_from_grib_files = ReadGribFiles(PathToFile="D:\Downloads\gfs.grb2", BandToSelect=Slider(50, range=0..100))  # -> CatchErrors, Latitude, Longitude, DataSet, NumberOfBands
bnd = Bounds(Numbers=read_information_from_grib_files.DataSet)
dom = ConstructDomain(DomainStart=number_slider_2, DomainEnd=number_slider_3)
remap = RemapNumbers(Value=read_information_from_grib_files.DataSet, Source=bnd, Target=dom)  # -> Mapped, Clipped
webmercatorprojection = WebMercator(Latitude=read_information_from_grib_files.Latitude, Longitude=read_information_from_grib_files.Longitude)
cassiniprojection = Cassini(Latitude=read_information_from_grib_files.Latitude, Longitude=read_information_from_grib_files.Longitude)
sphericalprojection = Spherical(Latitude=read_information_from_grib_files.Latitude, Longitude=read_information_from_grib_files.Longitude)
gradient = Gradient(
    LowerLimit=number_slider_2,
    UpperLimit=number_slider_3,
    Parameter=remap.Mapped,
    stops=[0: RGB(0, 128, 0), 0.5: RGB(255, 255, 0), 1: RGB(255, 0, 0)])
construct = ConstructPointCloud(Points=webmercatorprojection, Colours=gradient)
preview = PreviewPointCloud(PointCloud=construct, Weight=Slider(5, range=0..10))
